% Simulink data dictionary mvdc_trajectory_driver.sldd
% references modelconfig.sldd
% references TUM_interfaces.sldd
% references mvdc_path_matching.sldd
% references mvdc_path_feedback.sldd
% references mvdc_performance_assessment.sldd
% references mvdc_curvvel_tracking.sldd
% references mvdc_mpc.sldd
% references pa_mvdc_trajectory_driver.sldd

Variant_NMPCDeactivated = Simulink.Variant(Condition="P_VDC_EnableNMPC==0")
P_VDC_VEH__Brakes__n_BrakePadsNumberFrRe__2 = Simulink.Parameter(1)
P_VDC_VEH__Brakes__d_BrakeActuatorBoreFrRe_m__2 = Simulink.Parameter(0.0798)
P_VDC_POWTR__DIFFERENTIAL__c_diff_ratio = Simulink.Parameter(3)
P_VDC_POWTR__DIFFERENTIAL__c_diff_efficiency = Simulink.Parameter(0.98)
P_VDC_POWTR__DIFFERENTIAL__f_diff_ratio = Simulink.Parameter(1)
P_VDC_POWTR__DIFFERENTIAL__f_diff_efficiency = Simulink.Parameter(0.99)
P_VDC_POWTR__DIFFERENTIAL__r_diff_ratio = Simulink.Parameter(1)
P_VDC_POWTR__DIFFERENTIAL__r_diff_efficiency = Simulink.Parameter(0.99)
P_VDC_POWTR__ENGINE__n_idle_rpm = Simulink.Parameter(1000)
P_VDC_VEH__Brakes__r_BrakePadsMeanLeverFrRe_m__2 = Simulink.Parameter(0.134)
P_VDC_POWTR__ENGINE__n_limit_rpm = Simulink.Parameter(6800)
P_VDC_POWTR__ENGINE__n_ub_rpm = Simulink.Parameter(4800)
P_VDC_VEH__Brakes__mue_BrakePadsFrRe_kinetic__2 = Simulink.Parameter(0.35)